# Grasshopper definition p2m.gh (Grasshopper 1.0.7)

ghpython_script = GhPythonScript()  # -> out, a
# ---------- ghpython_script: Python ----------
import urllib2
import json

base_url = "http://localhost:5000/p2m/"
image_path = "C:/Users/park1/"

url = base_url + image_path

request = urllib2.Request(url)
response = urllib2.urlopen(request)

a = json.loads(response.read())

print(a)
# ---------- end ghpython_script ----------
panel = Panel(ghpython_script.a)
