# Grasshopper definition scorepolygon_example.gh (Grasshopper 1.0.7)

textviz = BooleanToggle(True)
point = Point(Point(108.9772767, 10.60589367, 0))
ghpython_script = GhPythonScript(origin=point, textviz=textviz)  # inputs origin: Point3d, textviz: Boolean
# ---------- ghpython_script: Python ----------
from scorepolygon.scorepolygon import ScorePolygon
from utils.utils import ColorHelper


if __name__ == "__main__":
    import random
    random.seed(777)
    
    scoredict = {
        "Cat": -round(random.random(), 3),
        "Dog": -round(random.random(), 3),
        "Cow": round(random.random(), 3),
        "Sheep": round(random.random(), 3),
        "Mouse": -round(random.random(), 3),
        "Tiger": -round(random.random(), 3),
        "Lion": round(random.random(), 3),
    }
    
    scp = ScorePolygon(
        origin, 
        rad=7, 
        scoredict=scoredict, 
        toggle=textviz, 
#        color=ColorHelper.COLOR_RED
    )
# ---------- end ghpython_script ----------
