# Grasshopper definition k_rooms_cluster.gh (Grasshopper 1.0.7)
# plug-ins: Human, Shortest Walk in Gh

# ---- group: core
point = Point([Point(99.73913902, 7.790399127, 0), Point(102.1266606, 1.691035164, 0), Point(105.2927426, 2.930359338, 0), Point(102.9052211, 9.029723301, 0)])
point_2 = Point([Point(100.4317025, 6.021117977, 0), Point(100.9420125, 4.71743713, 0), Point(104.1080945, 5.956761304, 0), Point(103.5977846, 7.260442151, 0)])
polyline = PolyLine(Vertices=point, Closed=True)
polyline_2 = PolyLine(Vertices=point_2, Closed=True)

# ----
point_3 = Point([Point(87.78853375, 12.94273039, 0), Point(93.51272956, -1.680782989, 0), Point(113.3479533, 6.083473225, 0), Point(109.4102002, 16.14318934, 0)])

# ---- group: core
point_4 = Point([Point(139.4979311, 12.54167887, 0), Point(139.4979311, 7.891678874, 0), Point(145.0979311, 7.891678874, 0), Point(145.0979311, 12.54167887, 0)])
point_5 = Point([Point(139.4979311, 12.54167887, 0), Point(139.4979311, 9.791678874, 0), Point(142.2979311, 9.791678874, 0), Point(142.2979311, 11.14167887, 0), Point(145.0979311, 11.14167887, 0), Point(145.0979311, 12.54167887, 0)])
point_6 = Point([Point(139.4979311, 9.791678874, 0), Point(139.4979311, 7.891678874, 0), Point(142.2979311, 7.891678874, 0), Point(142.2979311, 9.791678874, 0)])
polyline_3 = PolyLine(Vertices=point_4, Closed=True)
polyline_4 = PolyLine(Vertices=point_5, Closed=True)
polyline_5 = PolyLine(Vertices=point_6, Closed=True)

# ----
point_7 = Point([Point(159.6159718, 25.26507987, 0), Point(134.4015959, 21.59753429, 0), Point(134.4015959, 7.891678874, 0), Point(159.6159718, 7.891678874, 0)])
polyline_6 = PolyLine(Vertices=point_3, Closed=True)
polyline_7 = PolyLine(Vertices=point_7, Closed=True)
number_slider = Slider(0, range=0..270)
ghpython_script = GhPythonScript(core=polyline, hall=polyline_2, floor=polyline_6)  # -> out, a, b, c; inputs core: Curve, hall: Curve, floor: Curve
# ---------- ghpython_script: Python ----------
from utils.kmeans.kmeans import KMeans
from utils.utils import PointHelper, LineHelper, ConstsCollection
import Rhino.Geometry as rg
import copy
import math



class Room:
    """
    _description_
    """
    
    
    def __init__(self, boundary, cells, path):
        self.boundary = boundary
        self.cells = cells
        self.path = path


class Boundary:
    """
    _description_
    """
    
    def __init__(self, boundary, target_area):
        self.boundary = boundary
        self.boundary_area = rg.AreaMassProperties.Compute(boundary).Area
        self.target_area = target_area
        
        self._gen_estimated_k()
        
    def _gen_estimated_k(self):
        """The K is given floor area divided target area."""
        self.k = int(self.boundary_area / self.target_area)
        
    def _gen_shortest_path(self):
        pass


class KRoomsCluster(KMeans, PointHelper, LineHelper, ConstsCollection):
    """
    To use the inherited moduels, refer the link below.
    https://github.com/PARKCHEOLHEE-lab/GhPythonUtils
    """
    
    def __init__(
        self, floor, core, hall, target_area, axis=None, grid_size=None
    ):
        self.floor = floor
        self.core = core
        self.hall = hall
        self.sorted_hall_segments = self.get_sorted_segment(self.hall)
        self.target_area = target_area
        self.axis = axis
        self.grid_size = grid_size
        
        KMeans.__init__(self)
        PointHelper.__init__(self)
        LineHelper.__init__(self)
        ConstsCollection.__init__(self)
        
        
    def get_predicted_rooms(self):
        self._gen_given_axis_aligned_obb()
        self._gen_boundaries()
        self._gen_estimated_grid_size()
        self._gen_grid()
        self._predict()
        
        return self.rooms
        
    def _gen_boundaries(self):
        boundaries = rg.Curve.CreateBooleanDifference(
            self.floor, self.core
        )
        
        self.boundaries = []
        for boundary in boundaries:
            boundary_object = Boundary(boundary, self.target_area)
            self.boundaries.append(boundary_object)
            
    def _gen_given_axis_aligned_obb(self):
        if self.axis is None:
            self.axis = self.core.DuplicateSegments()[0]
            
        self.obb = self.get_2d_obb_from_line(
            self.axis, self.floor
        ).ToNurbsCurve()
        
        if (
            self.obb.ClosedCurveOrientation() 
            != rg.CurveOrientation.CounterClockwise
        ):
           self.obb.Reverse()
        
    def _gen_estimated_grid_size(self):
        if self.grid_size is None:
            hall_shortest_segment = self.sorted_hall_segments[0]
            self.grid_size = hall_shortest_segment.GetLength()
            self.grid_size_x = self.sorted_hall_segments[-1].GetLength()
        
    def _gen_grid(self):
        base_rectangle = self.get_2d_offset_polygon(
            self.sorted_hall_segments[0], self.grid_size_x / 4
        )
        
        base_rectangle.Translate(
            (
                self.sorted_hall_segments[0].PointAtStart 
                - self.sorted_hall_segments[0].PointAtEnd
            ) / 2
        )
        
        x_segment, y_segment, _, _ = base_rectangle.DuplicateSegments()
        anchor = base_rectangle.ToPolyline().CenterPoint()
        plane = rg.Plane(
            origin=anchor, 
            xDirection=x_segment.PointAtEnd - x_segment.PointAtStart, 
            yDirection=y_segment.PointAtEnd - x_segment.PointAtStart
        )
        
        counts = []
        for vi, plane_element in enumerate(plane):
            if isinstance(plane_element, rg.Point3d):
                continue
            
            grid_size = x_segment.GetLength()
            if vi == 2:
                grid_size = y_segment.GetLength()
            
            projected_points = [
                self.get_projected_point_on_curve(
                    anchor, plane_element, self.obb
                ),
                self.get_projected_point_on_curve(
                    anchor, -plane_element, self.obb
                )
            ]
            
            for projected_point in projected_points:
                if projected_point is None:
                    continue
                
                count = int(
                    math.ceil(projected_point.DistanceTo(anchor) / grid_size)
                ) + 1
                
                counts.append(count)
        
        x_vectors = [plane.XAxis, -plane.XAxis]
        y_vectors = [plane.YAxis, -plane.YAxis]
        
        x_grid = [base_rectangle]
        for x_count, x_vector in zip(counts[:2], x_vectors):
            for xc in range(1, x_count):
                copied_rectangle = copy.copy(base_rectangle)
                vector = x_vector * x_segment.GetLength() * xc
                copied_rectangle.Translate(vector)
                x_grid.append(copied_rectangle)
                
        all_grid = [] + x_grid
        for rectangle in x_grid:
            for y_count, y_vector in zip(counts[2:], y_vectors):
                for yc in range(y_count):
                    copied_rectangle = copy.copy(rectangle)
                    vector = y_vector * y_segment.GetLength() * yc
                    copied_rectangle.Translate(vector)
                    all_grid.append(copied_rectangle)
        
        self.grid = []
        for grid in all_grid:
            for boundary in self.boundaries:
                tidied_grid = list(
                    rg.Curve.CreateBooleanIntersection(
                        boundary.boundary, grid, self.TOLERANCE
                    )
                )
                
                self.grid.extend(tidied_grid)
        
        self.grid_centroids = [
            rg.AreaMassProperties.Compute(g).Centroid for g in self.grid
        ]
    
    def _predict(self):
        self.points = self.grid_centroids
        self.k = self.boundaries[0].k
#        self.random_seed=1000
        
        _, indices = self.predict(get_indices=True)
        
        print(self.boundaries[0].k)
        
        self.rooms = []
        for each_indices in indices:
            room = []
            for index in each_indices:
                room.append(self.grid[index])
                
            self.rooms.extend(rg.Curve.CreateBooleanUnion(room))
        
        print(self.rooms)

if __name__ == "__main__":
    krooms = KRoomsCluster(
        floor=floor,
        core=core,
        hall=hall,
        target_area=40,
        grid_size=None
    )
    
    c = krooms.get_predicted_rooms()
    a = krooms.grid
#    b = [b.boundary for b in krooms.boundaries]
##    print(c)
# ---------- end ghpython_script ----------
colour_swatch = ColourSwatch(SwatchColor=RGB(0, 0, 0))
custom_preview_lineweights = CustomPreviewLineweights(Geometry=ghpython_script.b, Shader=colour_swatch, Thickness=3, Absolute=False)
explode = Explode(Curve=ghpython_script.a, Recursive=True)  # -> flatten(Segments), flatten(Vertices)
ghpython_script_2 = GhPythonScript()  # -> out, a; inputs x: Curve
# ---------- ghpython_script_2: Python ----------
import rhinoscriptsyntax as rs
import Rhino.Geometry as rg
import Rhino.Display as rd
import math
import copy


CUSTOM_DISPLAY = "custom_display"


class ConstsCollection:
    TOLERANCE = 0.001
    
    HALF = 0.5
    INF = 1e15


class ColorsCollection:
    COLOR_BLACK = rd.ColorHSL(1, 0, 0, 0)
    COLOR_GRAY = rd.ColorHSL(0.5, 0, 0, 0.5)
    COLOR_RED = rd.ColorHSL(1, 0, 1, 0.5)
    COLOR_GREEN = rd.ColorHSL(1, 0.333, 1, 0.5)
    COLOR_BLUE = rd.ColorHSL(1, 0.666, 1, 0.5)


class Enum:
    @staticmethod
    def enum(*names):
        """Enumerated type creation helper

        Returns:
            Enum: custom enumerated type
        """
        
        enums = {}
        for ni, name in enumerate(names):
            enums[name] = ni
            
        return type("Enum", (), enums)


class LineHelper:
    @staticmethod
    def get_line_2d_angle(linestring, is_radians=True):
        """Calculate angle between two points

        Args:
            linestring (Rhino.Geometry.Curve): Segment with only two points
            is_radians (bool, optional): If False return to degree. Defaults to True.

        Returns:
            float: Angle of given linestring
        """
                
        x1, y1, _ = linestring.PointAtStart
        x2, y2, _ = linestring.PointAtEnd
        
        angle = math.atan2(y2 - y1, x2 - x1)
        if is_radians:
            return angle
        
        return math.degrees(angle)
    
    @staticmethod
    def get_2d_obb_from_line(linestring, geom):
        """Create an oriented bounding box by given axis of linestring 

        Args:
            linestring (Rhino.Geometry.Curve): Alignment axis
            geom (Rhino.Geometry.Curve): Geometry to create the obb

        Returns:
            Rhino.Geometry.Curve: Oriented bounding box aligned to given line axis
        """
        angle = LineHelper.get_line_2d_angle(linestring)
        anchor = geom.ToPolyline().CenterPoint()
        
        negative_transform = rg.Transform.Rotation(-angle, anchor)
        positive_transform = rg.Transform.Rotation(angle, anchor)
        
        copied_geom = copy.copy(geom)
        copied_geom.Transform(negative_transform)
        
        obb = copied_geom.GetBoundingBox(rg.Plane.WorldXY)
        obb = rg.Rectangle3d(rg.Plane.WorldXY, obb.Min, obb.Max)
        obb.Transform(positive_transform)
        
        return obb
        
    @staticmethod
    def get_sorted_segment(linestring, is_sort_by_longest=False):
        """Get sorted segments based on the length of each segment

        Args:
            linestring (Rhino.Geometry.Curve): To sort curve
            is_sort_by_longest (bool, optional): Sorting criteria. Defaults to False.

        Returns:
            List[Rhino.Geometry.Curve]: Sorted segments
        """
        
        exploded_linestring = linestring.DuplicateSegments()
        sorted_linestring = sorted(
            exploded_linestring, 
            key=lambda l: l.GetLength(), 
            reverse=is_sort_by_longest
        )
        
        return sorted_linestring
        
    @staticmethod
    def get_2d_offset_polygon(linestring, distance):
        """_summary_

        Args:
            linestring (Rhino.Geometry.Curve): Curve to make as a polygon
            distance (float): Distance to offset

        Raises:
            Exception: When closed curve

        Returns:
            Rhino.Geometry.Curve: Offset polygon
        """
        
        if linestring.IsClosed:
            raise Exception("Given linestring has been closed")
        
        offset_linestring_list = list(
            linestring.Offset(
                rg.Plane.WorldXY,
                distance,
                ConstsCollection.TOLERANCE,
                rg.CurveOffsetCornerStyle.Sharp
            )
        )
        
        vertices = []
        exploded_linestring = linestring.DuplicateSegments()
        for li, each_line in enumerate(exploded_linestring):
            vertices.append(each_line.PointAtStart)
            if li == len(exploded_linestring) - 1:
                vertices.append(each_line.PointAtEnd)
        
        offset_vertices = []
        for offset_line in offset_linestring_list:
            exploded_offset_linestring = offset_line.DuplicateSegments()
            
            for oli, each_offset_line in enumerate(exploded_offset_linestring):
                offset_vertices.append(each_offset_line.PointAtStart)
                if oli == len(exploded_offset_linestring) - 1:
                    offset_vertices.append(each_offset_line.PointAtEnd)
                
        return rg.PolylineCurve(
            vertices + offset_vertices[::-1] + vertices[:1]
        )


class NumericHelper:
    @staticmethod
    def is_close(n1, n2, tolerance=ConstsCollection.TOLERANCE):
        """Check if two numbers are within margin of error

        Args:
            n1 (float): Number to compare 
            n2 (float): Number to compare
            tolerance (float, optional): Permissible range. Defaults to ConstsCollection.TOLERANCE.

        Returns:
            bool: Compare result about whether two numbers are equal
        """
        
        return abs(n1 - n2) <= tolerance


class SurfaceHelper:
    @staticmethod
    def get_reparameterized_surface(srf):
        """Change domain to 0 ~ 1 given surface

        Args:
            srf (Rhino.Geometry.Surface): Surface to reparameterize

        Returns:
            Rhino.Geometry.Surface: Reparameterized surface
        """
        
        interval = rg.Interval(0, 1)
        
        copied_srf = copy.copy(srf)
        copied_srf.SetDomain(0, interval)
        copied_srf.SetDomain(1, interval)
        
        return copied_srf


class PointHelper:
    @staticmethod
    def get_points_cloud_centroid(points):
        """Find a centroid of given points.

        Args:
            points (List[Rhino.Geometry.Point3d]): Points cloud

        Returns:
            Rhino.Geometry.Point3d: Centroid of points cloud 
        """
        
        return rg.Point3d(
            *[sum(coord_list) / len(points) for coord_list in zip(*points)]
        )
        
    @staticmethod
    def get_projected_point_on_curve(anchor, vector, geometry):
        if not isinstance(geometry, rg.Curve):
            raise Exception("Unsupported geometry.")
        
        ray = rg.PolylineCurve([anchor, anchor + vector * 1e15])
        intersection = rg.Intersect.Intersection.CurveCurve(
            geometry, ray, 0.001, 0.001
        )
        
        projected_point = None
        for intersect in intersection:
            projected_point = intersect.PointA
            break
        
        return projected_point


class VisualizeHelper:
    """
    NOTE: If you RUN(F5) in ghpython scripting window, the text may not remove.
    """
    
    @classmethod
    def __initialize(cls):
        if CUSTOM_DISPLAY not in globals():
            globals()[CUSTOM_DISPLAY] = rd.CustomDisplay(True)
    
    @classmethod
    def __dispose(cls):
        globals()[CUSTOM_DISPLAY].Dispose()
        del globals()[CUSTOM_DISPLAY]
    
    @staticmethod
    def visualize_text(
        string, 
        height, 
        toggle, 
        color=ColorsCollection.COLOR_BLACK,
        string_place_origin=rg.Point3d(0, 0, 0), 
        string_place_plane=rg.Plane.WorldXY
    ):  
        """Text visualization helper

        Args:
            string (str): Text to visualize
            height (float): Text size
            toggle (bool): Whether text visualization ON or OFF
            color (Rhino.Display.ColorHSL, optional): Text color. Defaults to ColorHelper.COLOR_BLACK.
            string_place_origin (Rhino.Geometry.Point3d, optional): Location of text. Defaults to rg.Point3d(0, 0, 0).
            string_place_plane (Rhino.Geometry.Plane, optional): Text direction. Defaults to rg.Plane.WorldXY.
        """
        
        VisualizeHelper.__initialize()
        if not toggle:
            VisualizeHelper.__dispose()
        else:
            string_place_plane.Origin = string_place_origin
            text_3d = rd.Text3d(string, string_place_plane, height)
            globals()[CUSTOM_DISPLAY].AddText(text_3d, color)
    
    @staticmethod
    def visualize_curve(
        curve, toggle, color=ColorsCollection.COLOR_BLACK, thickness=1
    ):
        """Curve Visualization helper

        Args:
            curve (Rhino.Geometry.Curve): Curve to visualize
            toggle (bool): Whether curve visualization ON or OFF
            color (Rhino.Display.ColorHSL, optional): Curve color. Defaults to ColorHelper.COLOR_BLACK.
            thickness (int, optional): Curve display thickness. Defaults to 1.
        """
        
        VisualizeHelper.__initialize()
        if not toggle:
            VisualizeHelper.__dispose()
        else:
            globals()[CUSTOM_DISPLAY].AddCurve(curve, color, thickness)
    
    @staticmethod
    def visualize_polygon(
        polygon, 
        toggle,
        fill_color=ColorsCollection.COLOR_GRAY, 
        edge_color=ColorsCollection.COLOR_BLACK, 
        draw_fill=True,
        draw_edge=True,
    ):
        """Polygon visualization helper

        Args:
            polygon (List[Point3d]): Polygon to visualize
            toggle (bool): Whether polygon visualization ON or OFF
            fill_color (Rhino.Display.ColorHSL, optional): Polygon's inner color. Defaults to ColorHelper.COLOR_GRAY.
            edge_color (Rhino.Display.ColorHSL, optional): Polygon's edge color. Defaults to ColorHelper.COLOR_BLACK.
            draw_fill (bool, optional): Whether polygon inside fill. Defaults to True.
            draw_edge (bool, optional): Whether polygon edge visualization. Defaults to True.
            
        NOTE:
            This function is incomplete. Sometimes the concave part of the polygon is convexly filled
        """

        VisualizeHelper.__initialize()
        if not toggle:
            VisualizeHelper.__dispose()
        else:
            globals()[CUSTOM_DISPLAY].AddPolygon(
                polygon, fill_color, edge_color, draw_fill, draw_edge
            )
# ---------- end ghpython_script_2 ----------
custom_preview_lineweights_2 = CustomPreviewLineweights(Geometry=ghpython_script.c, Shader=colour_swatch, Thickness=3, Absolute=False)
list_item = ListItem(List=explode.Vertices, Index=Slider(118, range=0..1358), Wrap=True)
length = Length(Curve=explode.Segments)
list_item_2 = ListItem(List=explode.Vertices, Index=Slider(598, range=0..1358), Wrap=True)
line = Line(StartPoint=list_item, EndPoint=list_item_2)
shortest_walk = ShortestWalk(Curves=explode.Segments, Lengths=length, WantedPath=line)  # -> ShortestWalk, Succession, Direction, Length
curve = Curve(<curve referenced from the Rhino model>)
sweep1 = Sweep1(Rail=shortest_walk.ShortestWalk, Sections=curve, Miter=1)
horizontal_frame = HorizontalFrame(Curve=shortest_walk.ShortestWalk, Parameter=0)
