# Grasshopper definition quadtree.gh (Grasshopper 1.0.7)
# plug-ins: Human

point = Point([Point(186.3474552, 75.7933389, 0), Point(140.1990867, 4.978433866, 0), Point(238.5412925, -42.78778037, 0), Point(278.346471, 14.81265444, 0), Point(242.2876622, 49.46657457, 0)])
polyline = PolyLine(Vertices=point, Closed=True)
line = Line(Line((99.34242822, -75.36399844, 0), (271.0947023, 57.36763375, 0)))
ghpython_script = GhPythonScript(input_curve=polyline)  # -> out, quadtree_geometries, b, c; inputs input_curve: Curve
# ---------- ghpython_script: Python ----------
from ghpythonutils.utils.utils import LineHelper, ConstsCollection

import Rhino.Geometry as rg


class Quadtree:
    COUNTER = 1
    
    def __init__(self, bounding_box, min_size=2):
        self.bounding_box = bounding_box
        self.min_size = min_size
        
        self.crvs = []
        self.children = None
        self.children_geometries = None
        
        self._post_init()
        
    def _post_init(self):
        exploded_bounding_box = self.bounding_box.DuplicateSegments()
        
        self.width, self.height, _, _ = [
            seg.GetLength() for seg in exploded_bounding_box
        ]
        
        is_plane_created, self.plane = exploded_bounding_box[0].FrameAt(
            ConstsCollection.HALF
        )
        
        centroid = rg.AreaMassProperties.Compute(self.bounding_box).Centroid
        
        self.plane.Origin = centroid
        
    def _subdivide(self):
        
        ne_bb = rg.Rectangle3d(self.plane, self.width / 2, self.height / 2)
        ne_bb = ne_bb.ToNurbsCurve()
        
        nw_bb = rg.Rectangle3d(self.plane, -self.width / 2, self.height / 2)
        nw_bb = nw_bb.ToNurbsCurve()
        
        se_bb = rg.Rectangle3d(self.plane, self.width / 2, -self.height / 2)
        se_bb = se_bb.ToNurbsCurve()
        
        sw_bb = rg.Rectangle3d(self.plane, -self.width / 2, -self.height / 2)
        sw_bb = sw_bb.ToNurbsCurve()
        
        ne = Quadtree(ne_bb)
        nw = Quadtree(nw_bb)
        se = Quadtree(se_bb)
        sw = Quadtree(sw_bb)

        self.children = [ne, nw, se, sw]
        self.children_geometries = [ne_bb, nw_bb, se_bb, sw_bb]

        for crv in self.crvs:
            if self._is_intersects(crv, ne_bb):
                ne.insert(crv)
            if self._is_intersects(crv, nw_bb):
                nw.insert(crv)
            if self._is_intersects(crv, se_bb):
                se.insert(crv)
            if self._is_intersects(crv, sw_bb):
                sw.insert(crv)
    
    def _is_intersects(self, crv, bb):
        intersects = rg.Intersect.Intersection.CurveCurve(
            crv, bb, ConstsCollection.TOLERANCE, ConstsCollection.TOLERANCE
        )
        
        return len(intersects) > 0
    
    def insert(self, crv):
        if self.children:
            for child in self.children:
                
                if self._is_intersects(crv, self.bounding_box):
                    child.insert(crv)
        else:
            self.crvs.append(crv)
            
            if (
                len(self.crvs) >= self.COUNTER
                and (self.width > self.min_size or self.height > self.min_size)
            ):
                self._subdivide()
                
def get_all_quadtree_geometries(quadtree):
    all_quadtree_geometries = []
    
    if quadtree.children:
        for child in quadtree.children:
            geoms = get_all_quadtree_geometries(child)
            
            if geoms is not None:
                all_quadtree_geometries.extend(geoms)
    
    elif quadtree.children is None:
        all_quadtree_geometries.append(quadtree.bounding_box)
    
    else:
        for child_geometry in quadtree.children_geometries:
            all_quadtree_geometries.append(child_geometry)
    
    return all_quadtree_geometries


if __name__ == "__main__":
    plane = rg.Plane.WorldXY
    
    l = rg.PolylineCurve([rg.Point3d(0,0,0), rg.Point3d(1,3,0)])
    bounding_box = LineHelper.get_2d_obb_from_line(
#        rg.PolylineCurve([plane.Origin, plane.Origin + plane.XAxis]),
        l,
        input_curve
    ).ToNurbsCurve()
    
    quadtree = Quadtree(min_size=5, bounding_box=bounding_box)
    exploded_curve = input_curve.DuplicateSegments()
    for crv in exploded_curve:
        quadtree.insert(crv)
        
    quadtree_geometries = get_all_quadtree_geometries(quadtree)
# ---------- end ghpython_script ----------
custom_preview_lineweights = CustomPreviewLineweights(
    Geometry=ghpython_script.c,
    Shader={diffuse=RGB(255, 105, 180), emission=RGB(76, 32, 54), shine=0.5, specular=RGB(255, 255, 255), transparency=0},
    Thickness=5,
    Absolute=False)
